# Grasshopper definition Terrain & Walls & Roofs.gh (Grasshopper 1.0.7)
# plug-ins: Pufferfish, Weaverbird, Speckle 2, Kangaroo2 Components, Human, MetaHopper, Rhino.Inside for Autodesk Revit, MeshEdit Components, ShapeDiverForGrasshopper

sddp = ShapeDiverDocumentPayload({AbsoluteTolerance=0, AngleTolerance=0, DistanceDisplayPrecision=0, GltfVersion="Gltf2", GrasshopperVersion="1.0.0007", InputGroups="{}", OutputGroups="{}", RelativeTolerance=0, RhinoVersion="7.36.23346.16351", UnitSystem=0, VersionCreated="1.14.0.0", VersionSaved="1.14.0.0"})

# ----
# TURN OFF
# BEFORE
# OPENING
# RHINO
# FILE
# UNITS & FLOORS (Sorted by Levels)
toggle = GroupToggle(ToggleActive=True, ToggleVisible=False)  # disabled

# ---- group: New Site Mesh (A4)
mesh = Mesh(<mesh referenced from the Rhino model>)  # disabled

# ---- group: Projection Plane Point
pt = Point(<point referenced from the Rhino model>)

# ---- group: UNITS (LATEST LOCATION)
brep = Brep([<brep referenced from the Rhino model> x74])

# ---- group: Units Internalised LATEST LOCATION
brep_2 = Brep([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])

# ----
volume = Volume(Geometry=brep_2)  # -> Volume, Centroid
# 03
# 02
# 01
# 00
pdecon = Deconstruct(Point=volume.Centroid)  # -> XComponent, YComponent, ZComponent
cset = CreateSet(List=pdecon.ZComponent)  # -> Set, Map
sort = SortList(Keys=cset.Set)  # -> Keys, ValuesA
mindex = MemberIndex(Set=pdecon.ZComponent, Member=graft(sort.Keys))  # -> Index, Count

# ---- group: Units Grouped by Level
item = ListItem(List=brep_2, Index=mindex.Index, Wrap=True)

# ----
# Contour Lines (Projected on plane above)
xy = XYPlane(Origin=pt)
project = Project(Geometry=flatten(item), Plane=xy)  # -> Geometry, Transform
debrep = DeconstructBrep(Brep=project.Geometry)  # -> Faces, flatten(Edges), Vertices
len = Length(Curve=debrep.Edges)
larger = LargerThan(FirstNumber=len, SecondNumber="0.001")  # -> LargerThan, OrEqualTo
cull = CullPattern(List=debrep.Edges, CullPattern=larger.LargerThan)
panel = Panel("""0
1""")
cull_2 = CullPattern(List=cull, CullPattern=panel)
join = JoinCurves(Curves=cull_2, Preserve=False)
runion = RegionUnion(Curves=flatten(join))
item_2 = ListItem(List=runion, Index=0, Wrap=True)  # -> Item, Item1
number_slider = Slider(0.49, range=0..20)
disc = Discontinuity(Curve=item_2.Item, Level=1)  # -> Points, Parameters
nurbs = NurbsCurve(Vertices=disc.Points, Degree=3, Periodic=True)  # -> Curve, Length, Domain
neg = Negative(Value=number_slider)
xy_2 = XYPlane(Origin=Point(0, 0, 0))
offset = OffsetCurve(Curve=nurbs.Curve, Distance=number_slider, Corners=3)
offset_2 = OffsetCurve(Curve=offset, Distance=neg, Plane=xy_2, Corners=1)
offset_3 = OffsetCurve(Curve=offset_2, Distance=neg, Plane=xy_2, Corners=1)
series = Series(Start=Slider(0.06, range=-2..5), Step=Slider(2.03, range=-2..5), Count=Slider(7, range=0..10))
offset_4 = OffsetCurve(Curve=nurbs.Curve, Distance=series, Corners=1)  # -> flatten(Curve)

debrep_2 = DeconstructBrep(Brep=item)  # -> Faces, Edges, Vertices
bang = ExplodeTree(Data=item)  # -> Branch0, Branch1, Branch2, Branch3
area = Area(Geometry=debrep_2.Faces)  # -> Area, Centroid
pdecon_2 = Deconstruct(Point=area.Centroid)  # -> XComponent, YComponent, ZComponent
brep_3 = Brep(bang.Branch3)
brep_4 = Brep(item)  # disabled
panel_2 = Panel()  # disabled
panel_3 = Panel()  # disabled
panel_4 = Panel("https://macad.speckle.xyz/streams/4975f9f0a8/commits/8fbb543497")  # disabled
sort_2 = SortList(Keys=pdecon_2.ZComponent, ValuesA=debrep_2.Faces)  # -> Keys, ValuesA
brep_5 = Brep([<brep referenced from the Rhino model> x71])  # disabled
item_3 = ListItem(List=sort_2.ValuesA, Index=0, Wrap=True)  # -> Item1, Item
esokv = ExtendSpeckleObjectByKeyValue(Keys=panel_3, Values=panel_2, selectedKitName="Objects")  # disabled

# ---- group: Floors Grouped by Levels
trim = TrimTree(Tree=item_3.Item, Depth=1)

# ----
receive = Receive(
    Stream=panel_4,
    AutoReceive=False,
    CurrentComponentState="expired",
    ExpandOutput=True,
    ReceiveOnOpen=False,
    ReceivedCommitId="8fbb543497",
    StreamWrapper="https://macad.speckle.xyz/projects/4975f9f0a8/models/@8fbb543497",
    selectedKitName="Objects")  # -> Info, CONTOURS, SOIL; disabled
panel_5 = Panel("https://macad.speckle.xyz/streams/4975f9f0a8/branches/site%2F04-community-site")  # disabled
area_2 = Area(Geometry=trim)  # -> Area, Centroid
Z = UnitZ(Factor="-1")

# ---- group: Community Site Stream (Last Commit at the time)
panel_6 = Panel("https://macad.speckle.xyz/streams/4975f9f0a8/commits/8fbb543497")  # disabled

# ----
move = Move(Geometry=area_2.Centroid, Motion=Z)  # -> Geometry, Transform
panel_7 = Panel("First one here :)")  # disabled
project_2 = ProjectPoint(Point=move.Geometry, Direction=Vector(0, 0, -1), Geometry=flatten(trim))  # -> Point, Index
bbox = BoundingBox(Content=brep_5, Plane=PlaneXY(0, 0, 0), UnionBox=True)  # -> Box, Box_2; disabled
number_slider_2 = Slider(100, range=0..1000)  # disabled
null = NullItem(Item=project_2.Point)  # -> NullFlags, InvalidFlags, Description
volume_2 = Volume(Geometry=bbox.Box_2)  # -> Volume, Centroid; disabled

# ---- group: Floors by Levels (no duplication)
cull_3 = CullPattern(List=trim, CullPattern=null.NullFlags)

# ----
receive_2 = Receive(
    Stream=panel_6,
    AutoReceive=False,
    CurrentComponentState="expired",
    ExpandOutput=True,
    ReceiveOnOpen=False,
    ReceivedCommitId="8fbb543497",
    StreamWrapper="https://macad.speckle.xyz/projects/4975f9f0a8/models/@8fbb543497",
    selectedKitName="Objects")  # -> Info, CONTOURS, SOIL; disabled
send = Send(
    Stream=panel_5,
    Message=panel_7,
    Brep=brep_5,
    AutoSend=False,
    BaseId="4211a9499277c30a864f8af716dcf53c",
    CurrentComponentState="expired",
    KitName="Objects",
    OutputWrappers="https://macad.speckle.xyz\t4975f9f0a8\t25e44ca5db",
    UseDefaultCache=True,
    selectedKitName="Objects")  # disabled
sph = Sphere(Base=volume_2.Centroid, Radius=number_slider_2)  # disabled
edges = BrepEdges(Brep=cull_3)  # -> Naked, Interior, NonManifold
join_2 = BrepJoin(Breps=cull_3)  # -> Breps, Closed

crv = Curve(item_2.Item1)
disc_2 = Discontinuity(Curve=crv, Level=1)  # -> Points, Parameters
nurbs_2 = NurbsCurve(Vertices=disc_2.Points, Degree=3, Periodic=True)  # -> Curve, Length, Domain

panel_8 = Panel("""ELEMENTAL MARS
G06
VOLUME
MULTIPLE
SITE-PLACE HOLDER
NO MATERIAL""")  # disabled
panel_9 = Panel("""BIMSC-PROJECT
BIMSC-ORIGINATOR
BIMSC-VOLUME
BIMSC-LEVEL
BIMSC-TYPE
BIMSC-MATERIAL""")  # disabled
edges_2 = BrepEdges(Brep=join_2.Breps)  # -> Naked, Interior, NonManifold
trim_2 = TrimTree(Tree=edges.Naked, Depth=1)
pt_2 = Point([<point referenced from the Rhino model> x4])

# ---- group: Materials Stream
panel_10 = Panel("https://macad.speckle.xyz/streams/4975f9f0a8/commits/d13e3ec6c6")  # disabled

# ----
dso = DeconstructSpeckleObject(SpeckleObject=receive_2.SOIL, selectedKitName="Objects")  # disabled
geo = Geometry(edges_2.Naked)

# ---- group: G06 Stream
panel_11 = Panel("https://macad.speckle.xyz/streams/4975f9f0a8/branches/students%2Fg06-site_locations")  # disabled

# ----
number_slider_3 = Slider(3, range=0..20)  # disabled
panel_12 = Panel("A4")  # disabled
mesh_2 = Mesh(dso)  # disabled
receive_3 = Receive(
    Stream=panel_10,
    AutoReceive=False,
    CurrentComponentState="expired",
    ExpandOutput=True,
    ReceiveOnOpen=False,
    ReceivedCommitId="d13e3ec6c6",
    StreamWrapper="https://macad.speckle.xyz/projects/4975f9f0a8/models/@d13e3ec6c6",
    selectedKitName="Objects")  # -> Info, Materials; disabled
boundary = BoundarySurfaces(Edges=geo)
rev = ReverseList(List=pt_2)
esokv_2 = ExtendSpeckleObjectByKeyValue(SpeckleObject=brep_4, Keys=panel_9, Values=panel_8, selectedKitName="Objects")  # disabled
sovk = SpeckleObjectValueByKey(Object=receive_2.SOIL, Key=panel_12, selectedKitName="Objects")  # disabled
area_3 = Area(Geometry=boundary)  # -> Area, Centroid
cps = ClosestPoints(Point=pt_2, Cloud=disc_2.Points, Count="24")  # -> ClosestPoint, CPIndex, Distance
cir = Circle(Plane=pt_2, Radius=1)  # -> graft(Circle)
panel_13 = Panel("Footprint")  # disabled
dso_2 = DeconstructSpeckleObject(SpeckleObject=receive_3.Materials, selectedKitName="Objects")  # disabled
trim_3 = TrimTree(Tree=area_3.Centroid, Depth=1)
item_4 = ListItem(List=flatten(mesh_2), Index=number_slider_3, Wrap=True)  # disabled
disc_3 = Discontinuity(Curve=geo, Level=1)  # -> flatten(Points), Parameters
pdecon_3 = Deconstruct(Point=trim_3)  # -> XComponent, YComponent, ZComponent
alongcrv = SortAlongCurve(Points=cps.ClosestPoint, Curve=cir)  # -> Points, Indices
send_2 = Send(
    Stream=panel_11,
    Message=panel_13,
    Data=esokv_2,
    AutoSend=False,
    BaseId="5c085f5baf2f57c841840d9e65b2c551",
    CurrentComponentState="expired",
    KitName="Objects",
    OutputWrappers="https://macad.speckle.xyz\t4975f9f0a8\t123ad7dd3c",
    UseDefaultCache=True,
    selectedKitName="Objects")  # disabled
# Speckle
panel_14 = Panel(dso_2)  # disabled
preview = CustomPreview(Geometry=boundary, Material=ColourSwatch(SwatchColor=RGB(117, 117, 117)))
item_5 = ListItem(List=pdecon_3.ZComponent, Index=0, Wrap=True)
merge = Merge(Data1=Slider(1, range=0..23), Data2=Slider(1, range=0..23), Data3=Slider(1, range=0..23), Data4=Slider(7, range=0..23))  # -> graft(Result)
pt_3 = Point(<point referenced from the Rhino model>)
shift = ShiftList(List=alongcrv.Points, Shift=merge, Wrap=True)
pdecon_4 = Deconstruct(Point=pt_3)  # -> XComponent, YComponent, ZComponent
flatten = FlattenTree(Tree=item_5, Path="{0}")
pline = PolyLine(Vertices=shift, Closed=True)
roundd = RoundToDecimalPlace(NumberX=pdecon_4.XComponent, DecimalPlace="2", RoundType=0)  # -> Rounded, Difference
roundd_2 = RoundToDecimalPlace(NumberX=pdecon_4.YComponent, DecimalPlace="2", RoundType=0)  # -> Rounded, Difference
boundary_2 = BoundarySurfaces(Edges=pline)
points = PointList(Points=shift, Size=Slider(1, range=0..10))
item_6 = ListItem(List=flatten, Index=Slider(3, range=0..3), Wrap=True)
panel_15 = Panel(roundd_2.Rounded)
panel_16 = Panel(roundd.Rounded)
panel_17 = Panel(item_6)
area_4 = Area(Geometry=boundary_2)  # -> Area, Centroid
pdecon_5 = Deconstruct(Point=area_4.Centroid)  # -> XComponent, YComponent, ZComponent
subtraction = Subtraction(A=item_5, B=pdecon_5.ZComponent)
Z_2 = UnitZ(Factor=subtraction)
move_2 = Move(Geometry=boundary_2, Motion=Z_2)  # -> Geometry, Transform

# ----
# TURN OFF
# BEFORE
# OPENING
# RHINO
# FILE
toggle_2 = GroupToggle(ToggleActive=True, ToggleVisible=False)  # disabled

# ----
# Pavilions Outline - Curved
number_slider_4 = Slider(-0.4, range=-2..2)
brep_6 = Brep(item)
volume_3 = Volume(Geometry=brep_6)  # -> Volume, Centroid
plfit = PlaneFit(Points=flatten(volume_3.Centroid))  # -> Plane, Deviation
Z_3 = UnitZ(Factor=Slider(1.5, range=-5..5))
offset_5 = OffsetCurve(Curve=nurbs_2.Curve, Distance=number_slider_4, Corners=1)
Z_4 = UnitZ(Factor=Slider(-1.2, range=-5..0))
move_3 = Move(Geometry=plfit.Plane, Motion=Z_3)  # -> Geometry, Transform
move_4 = Move(Geometry=plfit.Plane, Motion=Z_4)  # -> Geometry, Transform
Z_5 = UnitZ(Factor=1)
projecta = ProjectAlong(Geometry=offset_5, Plane=move_3.Geometry, Direction=Z_5)  # -> Geometry, Transform

Z_6 = UnitZ(Factor=1)
projecta_2 = ProjectAlong(Geometry=offset_4, Plane=move_4.Geometry, Direction=Z_6)  # -> Geometry, Transform

# ----
# Pavilions Ground
projecta_3 = ProjectAlong(Geometry=crv, Plane=move_4.Geometry, Direction=Z_6)  # -> Geometry, Transform
patch = Patch(Points=disc_3.Points, Spans=20, Flexibility=5, Trim=True)
project_3 = Project(Curve=crv, Brep=patch, Direction=Vector(0, 0, 1))
srfsplit = SurfaceSplit(Surface=patch, Curves=project_3)
boundary_3 = BoundarySurfaces(Edges=projecta_3.Geometry)
item_7 = ListItem(List=srfsplit, Index="1", Wrap=True)
swatch = ColourSwatch(SwatchColor=RGB(77, 87, 62))
contour = Contour(Shape=item_7, Point=Point(0, 0, 0), Direction=Vector(0, 0, 1), Distance="0.5")
preview_2 = CustomPreview(Geometry=item_7, Material=ColourSwatch(SwatchColor=RGB(99, 99, 99)))  # disabled

# ----
# Units (Pebbles)
brep_7 = Brep(item)
mesh_3 = MeshBrep(
    Brep=brep_7,
    Settings={GridMaxCount=0, GridMinCount=16, JaggedSeams=False, MaxEdgeLength=0, MinEdgeLength=0.0001, MinTolerance=0, Refine=True, RefineAngle=0, RelativeTolerance=0.65, SimplePlanes=True, Tolerance=0})
wbcatmullclark = WeaverbirdsCatmullClarkSubdivision(MeshCurves=mesh_3, Level=Slider(2, range=0..2), SmoothNakedEdges=Slider(0, range=0..2))
preview_3 = CustomPreview(Geometry=brep_7, Material=ColourSwatch(SwatchColor=RGBA(189, 189, 189, 205)))  # disabled
preview_4 = CustomPreview(Geometry=wbcatmullclark, Material=ColourSwatch(SwatchColor=RGB(145, 142, 132)))  # disabled

panel_18 = Panel("""0
0
1""")

# ---- group: Original Wall Control Points
# Pavilions Outline - Dispatched Points
pt_4 = Point(disc_2.Points)

# ----
Z_7 = UnitZ(Factor=Slider(-0.5, range=-10..10))
move_5 = Move(Geometry=patch, Motion=Z_7)  # -> Geometry, Transform
cull_4 = CullPattern(List=pt_4, CullPattern=invert(panel_18))
cull_5 = CullPattern(List=pt_4, CullPattern=panel_18)
partition = PartitionList(List=cull_4, Size="2")
avr = Average(Input=partition)
scale = Scale(Geometry=partition, Center=avr, Factor=Slider(0.16, range=0..1))  # -> flatten(Geometry), Transform

crv_cp = CurveClosestPoint(Point=cull_5, Curve=offset_5)  # -> Point, Parameter, Distance
eval = EvaluateCurve(Curve=offset_5, Parameter=crv_cp.Parameter)  # -> Point, Tangent, Angle
rotate = Rotate(Geometry=eval.Tangent, Angle=1.570796327, Plane=PlaneXY(0, 0, 0))  # -> Geometry, Transform
amp = Amplitude(Vector=rotate.Geometry, Amplitude=Slider(4, range=-10..10))
vdis = VectorDisplay(Anchor=eval.Point, Vector=rotate.Geometry)
move_6 = Move(Geometry=cull_5, Motion=amp)  # -> Geometry, Transform

crv_cp_2 = CurveClosestPoint(Point=scale.Geometry, Curve=offset_5)  # -> Point, Parameter, Distance
eval_2 = EvaluateCurve(Curve=offset_5, Parameter=crv_cp_2.Parameter)  # -> Point, Tangent, Angle
rotate_2 = Rotate(Geometry=eval_2.Tangent, Angle=1.570796327, Plane=PlaneXY(0, 0, 0))  # -> Geometry, Transform
amp_2 = Amplitude(Vector=rotate_2.Geometry, Amplitude=Slider(-0.5, range=-10..10))
vdis_2 = VectorDisplay(Anchor=eval_2.Point, Vector=rotate_2.Geometry)
move_7 = Move(Geometry=cull_4, Motion=amp_2)  # -> Geometry, Transform

# ---- group: 1s
index = ItemIndex(List=pt_4, Item=cull_5)

# ---- group: 2s
index_2 = ItemIndex(List=pt_4, Item=cull_4)

# ----
previewlw = CustomPreviewLineweights(
    Geometry=contour,
    Shader=ColourSwatch(SwatchColor=RGB(255, 255, 255)),
    Thickness=Slider(3.07, range=0..5),
    Absolute=False)

# ---- group: Floors Reference Planes
srf = Surface([<surface referenced from the Rhino model> x4])

# ----
panel_19 = Panel("""0
1
12
13
16
17
32
33
44
45
48
49""")
edges_3 = BrepEdges(Brep=srf)  # -> Naked, Interior, NonManifold
replace = ReplaceItems(List=pt_4, Item=move_6.Geometry, Indices=index, Wrap=False)
item_8 = ListItem(List=cull_4, Index=panel_19, Wrap=True)

crv_cp_3 = CurveClosestPoint(Point=item_8, Curve=offset_5)  # -> Point, Parameter, Distance
eval_3 = EvaluateCurve(Curve=offset_5, Parameter=crv_cp_3.Parameter)  # -> Point, Tangent, Angle
rotate_3 = Rotate(Geometry=eval_3.Tangent, Angle=1.570796327, Plane=PlaneXY(0, 0, 0))  # -> Geometry, Transform
vdis_3 = VectorDisplay(Anchor=eval_3.Point, Vector=rotate_3.Geometry)
amp_3 = Amplitude(Vector=rotate_3.Geometry, Amplitude=Slider(0.5, range=-10..10))
move_8 = Move(Geometry=item_8, Motion=amp_3)  # -> Geometry, Transform

preview_5 = CustomPreview(Geometry=srf, Material=ColourSwatch(SwatchColor=RGB(242, 255, 0)))  # disabled
replace_2 = ReplaceItems(List=replace, Item=move_7.Geometry, Indices=index_2, Wrap=False)
join_3 = JoinCurves(Curves=edges_3.Naked, Preserve=False)  # -> flatten(Curves)
panel_20 = Panel("""0
1
18
19
24
25
48
49
66
67
72
73""")
replace_3 = ReplaceItems(List=replace_2, Item=item_8, Indices=panel_20, Wrap=False)
Z_8 = UnitZ(Factor=Slider(3.5, range=-5..15))
nurbs_3 = NurbsCurve(Vertices=replace_3, Degree=3, Periodic=True)  # -> Curve, Length, Domain
move_9 = Move(Geometry=patch, Motion=Z_8)  # -> Geometry, Transform
project_4 = ProjectPoint(Point=replace_3, Direction=Vector(0, 0, -1), Geometry=move_9.Geometry)  # -> Point, Index
Z_9 = UnitZ(Factor=Slider(2, range=-5..5))
item_9 = ListItem(List=project_4.Point, Index=index, Wrap=True)

# ---- group: Anchors
pt_5 = Point([<point referenced from the Rhino model> x4])

# ----
move_10 = Move(Geometry=item_9, Motion=Z_9)  # -> Geometry, Transform
panel_21 = Panel("""0
1
18
19
24
25
48
49
66
67
72
73""")
replace_4 = ReplaceItems(List=project_4.Point, Item=move_10.Geometry, Indices=index, Wrap=False)
item_10 = ListItem(List=replace_4, Index=panel_21, Wrap=True)
Z_10 = UnitZ(Factor=Slider(2.06, range=0..10))
move_11 = Move(Geometry=item_10, Motion=Z_10)  # -> Geometry, Transform
project_5 = Project(Curve=offset_5, Brep=patch, Direction=Vector(0, 0, 1))  # -> flatten(Curve)
Z_11 = UnitZ(Factor=Slider(1, range=-10..10))
project_6 = Project(Curve=offset_5, Brep=patch, Direction=Vector(0, 0, 1))
Z_12 = UnitZ(Factor=Slider(-0.5, range=-10..10))
replace_5 = ReplaceItems(List=replace_4, Item=move_11.Geometry, Indices=panel_21, Wrap=False)
move_12 = Move(Geometry=project_5, Motion=Z_12)  # -> Geometry, Transform
move_13 = Move(Geometry=project_6, Motion=Z_11)  # -> Geometry, Transform
nurbs_4 = NurbsCurve(Vertices=replace_5, Degree=3, Periodic=True)  # -> Curve, Length, Domain
rebcrv = RebuildCurve(Curve=move_13.Geometry, EndTangents=False)
rebcrv_2 = RebuildCurve(Curve=move_12.Geometry, EndTangents=False)
previewlw_2 = CustomPreviewLineweights(
    Geometry=[nurbs_4.Curve, move_13.Geometry, move_12.Geometry],
    Shader=ColourSwatch(SwatchColor=RGB(153, 0, 0)),
    Thickness=Slider(6.3, range=0..10),
    Absolute=False)

# ---- group: Doors Locations
crv_2 = Curve([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])

# ----
crv_3 = Curve(crv_2)
disc_4 = Discontinuity(Curve=crv_3, Level=1)  # -> Points, Parameters
area_5 = Area(Geometry=crv_3)  # -> Area, Centroid
nurbs_5 = NurbsCurve(Vertices=disc_4.Points, Degree=3, Periodic=True)  # -> Curve, Length, Domain
scale_2 = Scale(Geometry=flatten(nurbs_5.Curve), Center=area_5.Centroid, Factor=Slider(0.74, range=0..1))  # -> Geometry, Transform
boundary_4 = BoundarySurfaces(Edges=scale_2.Geometry)
offsrf = OffsetSurface(Surface=boundary_4, Distance=Slider(2.4, range=-3..5), BothSides=0, CreateSolid=True)
join_4 = BrepJoin(Breps=flatten(offsrf))  # -> Breps, Closed
Z_13 = UnitZ(Factor=Slider(-0.4, range=-2..2))
move_14 = Move(Geometry=join_4.Breps, Motion=Z_13)  # -> Geometry, Transform

# ----
# Openings
number_slider_5 = Slider(0, range=0..5)
loft_opt = LoftOptions(Closed=False, Adjust=True, Rebuild=Slider(800, range=0..1000), Refit=0, Type=number_slider_5)

toggle_3 = GroupToggle(ToggleActive=True, ToggleVisible=False)  # disabled
# Wall
merge_2 = Merge(Data1=flatten(nurbs_4.Curve), Data2=flatten(rebcrv), Data3=flatten(rebcrv_2))
loft = Loft(Curves=merge_2, Options=loft_opt)
offsrf_2 = OffsetSurface(Surface=loft, Distance=Slider(-0.3, range=-1..1), BothSides=0, CreateSolid=True)

sdiff = SolidDifference(BrepsA=offsrf_2, BrepsB=move_14.Geometry)
swatch_2 = ColourSwatch(SwatchColor=RGB(166, 140, 108))
preview_6 = CustomPreview(Geometry=sdiff, Material=ColourSwatch(SwatchColor=RGB(166, 40, 40)))  # disabled
# To Revit...  and Beyond
number_slider_6 = Slider(1, range=0..1)

# ---- group: Building Pads
join_5 = JoinCurves(Curves=geo, Preserve=False)  # -> flatten(Curves)

# ---- group: Roof Mesh
mesh_4 = Mesh(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)

# ----
levels = QueryLevels(BuildingStory=True)
item_11 = ListItem(List=join_3, Index=0, Wrap=True)  # -> Item, Item1, Item2, Item3
item_12 = ListItem(Index=0, Wrap=True)  # -> Item, Item1, Item2, Item3
trigger = Trigger(Interval=-1000, TimerInterval=1000, Target=[buildingpad, buildingpad_4, buildingpad_2, buildingpad_3])
g_shape = AddDirectShapeGeometry(Category=<geometry referenced from the Revit model>, TrackingMode=2)
item_13 = ListItem(List=join_5, Index=0, Wrap=True)  # -> Item, Item1, Item2, Item3, Item4, Item5, Item6, Item7, Item8
buildingpad = AddBuildingPad(Boundary=item_11.Item, Level=item_12.Item, TrackingMode=2)
buildingpad_2 = AddBuildingPad(Boundary=item_11.Item2, Level=item_12.Item2, TrackingMode=2)
buildingpad_3 = AddBuildingPad(Boundary=item_11.Item3, Level=item_12.Item3, TrackingMode=2)
buildingpad_4 = AddBuildingPad(Boundary=item_11.Item1, Level=item_12.Item1, TrackingMode=2)
g_shape_2 = AddDirectShapeGeometry(Category=<geometry referenced from the Revit model>, Geometry=mesh_4, TrackingMode=2)
g_shape_3 = AddDirectShapeGeometry(Category=<geometry referenced from the Revit model>, Geometry=sdiff, TrackingMode=2)
buildingpad_5 = AddBuildingPad(Boundary=item_13.Item8, Level=item_12.Item3, TrackingMode=2)
buildingpad_6 = AddBuildingPad(Boundary=item_13.Item7, Level=item_12.Item3, TrackingMode=2)
buildingpad_7 = AddBuildingPad(Boundary=item_13.Item5, Level=item_12.Item2, TrackingMode=2)
buildingpad_8 = AddBuildingPad(Boundary=item_13.Item6, Level=item_12.Item2, TrackingMode=2)
buildingpad_9 = AddBuildingPad(Boundary=item_13.Item4, Level=item_12.Item2, TrackingMode=2)
buildingpad_10 = AddBuildingPad(Boundary=item_13.Item1, Level=item_12.Item1, TrackingMode=2)
buildingpad_11 = AddBuildingPad(Boundary=item_13.Item3, Level=item_12.Item2, TrackingMode=2)
trigger_2 = Trigger(
    Interval=-1000,
    TimerInterval=1000,
    Target=[buildingpad_12, buildingpad_10, buildingpad_13, buildingpad_11, buildingpad_9, buildingpad_7, buildingpad_8, buildingpad_6, buildingpad_5])
buildingpad_12 = AddBuildingPad(Boundary=item_13.Item, Level=item_12.Item, TrackingMode=2)
buildingpad_13 = AddBuildingPad(Boundary=item_13.Item2, Level=item_12.Item1, TrackingMode=2)
trigger_3 = Trigger(Interval=-1000, TimerInterval=1000, Target=topography)
Y = UnitY(Factor=250)
move_15 = Move(Motion=Y)  # -> Geometry, Transform

triremesh = TriRemesh(Geometry=mesh, Iterations=25)  # -> Triangulation, Dual, Creases
# Terrain
medges = MeshEdges(Mesh=triremesh.Triangulation)  # -> NakedEdges, InteriorEdges, NonManifoldEdges
dom = ConstructDomain(DomainStart=Slider(0.49, range=0..1), DomainEnd=Slider(0.69, range=0..1))
dom_2 = ConstructDomain(DomainStart=Slider(0.4, range=0..1), DomainEnd=Slider(0.55, range=0..1))
dom² = ConstructDomain²(DomainU=dom, DomainV=dom_2)

item_14 = ListItem(List=triremesh.Triangulation, Index="1", Wrap=True)
Z_14 = UnitZ(Factor=1)
move_16 = Move(Geometry=item_14, Motion=Z_14)  # -> Geometry, Transform
medges_2 = MeshEdges(Mesh=move_16.Geometry)  # -> NakedEdges, InteriorEdges, NonManifoldEdges
previewlw_3 = CustomPreviewLineweights(
    Geometry=medges_2.NakedEdges,
    Shader=ColourSwatch(SwatchColor=RGB(0, 0, 0)),
    Thickness=Slider(2, range=0..100),
    Absolute=False)

contour_2 = Contour(Shape=item_14, Point=Point(0, 0, 0), Direction=Vector(0, 0, 1), Distance=Slider(1, range=0..50))
patch_2 = Patch(Curves=flatten(contour_2), Spans=20, Flexibility=1, Trim=True)

preview_7 = CustomPreview(Geometry=item_14, Material=ColourSwatch(SwatchColor=RGB(194, 194, 194)))  # disabled
subsrf = Isotrim(Surface=patch_2, Domain=dom²)

debrep_3 = DeconstructBrep(Brep=subsrf)  # -> Faces, Edges, Vertices
contour_3 = Contour(Shape=subsrf, Point=Point(0, 0, 0), Direction=Vector(0, 0, 1), Distance=Slider(1, range=0..50))
join_6 = JoinCurves(Curves=debrep_3.Edges, Preserve=False)
project_7 = Project(Curve=offset_4, Brep=subsrf, Direction=Vector(0, 0, 1))  # -> flatten(Curve)

# ---- group: Patch - Terrain
# Terrain & Contours (Patch)
toggle_4 = GroupToggle(ToggleActive=True, ToggleVisible=False)  # disabled
item_15 = ListItem(List=project_7, Index=0, Wrap=True)  # -> Item2, Item1, Item
Z_15 = UnitZ(Factor=Slider(1, range=0..6))
move_17 = Move(Geometry=geo, Motion=Z_15)  # -> Geometry, Transform
plfit_2 = PlaneFit(Points=debrep_3.Vertices)  # -> Plane, Deviation
offset_6 = OffsetCurve(Curve=join_6, Distance=Slider(-5, range=-5..5), Plane=plfit_2.Plane, Corners=1)  # -> flatten(Curve)
merge_3 = Merge(Data1=flatten(move_17.Geometry), Data2=item_15.Item2, Data3=join_6, Data4=offset_6)  # -> flatten(Result)
patch_3 = Patch(Curves=merge_3, Spans=20, Flexibility=Slider(5, range=1..15), Trim=True)
project_8 = Project(Curve=crv, Brep=patch_3, Direction=Vector(0, 0, 1))
srfsplit_2 = SurfaceSplit(Surface=patch_3, Curves=project_8)
item_16 = ListItem(List=srfsplit_2, Index=0, Wrap=True)
contour_4 = Contour(Shape=item_16, Point=Point(0, 0, 0), Direction=Vector(0, 0, 1), Distance="0.5")

# ---- group: Trimmed
mesh_5 = MeshBrep(
    Brep=item_16,
    Settings={GridMaxCount=0, GridMinCount=16, JaggedSeams=False, MaxEdgeLength=0, MinEdgeLength=0.0001, MinTolerance=0, Refine=True, RefineAngle=0, RelativeTolerance=0.65, SimplePlanes=True, Tolerance=0})

# ----
previewlw_4 = CustomPreviewLineweights(Geometry=contour_4, Shader=ColourSwatch(SwatchColor=RGB(0, 0, 0)), Thickness=Slider(1.9, range=0..5), Absolute=False)

# ---- group: Not Clipped
mesh_6 = MeshBrep(
    Brep=patch_3,
    Settings={GridMaxCount=0, GridMinCount=16, JaggedSeams=False, MaxEdgeLength=0, MinEdgeLength=0.0001, MinTolerance=0, Refine=True, RefineAngle=0, RelativeTolerance=0.65, SimplePlanes=True, Tolerance=0})

# ----
preview_8 = CustomPreview(Geometry=mesh_6, Material=ColourSwatch(SwatchColor=RGB(166, 140, 103)))
triremesh_2 = TriRemesh(Geometry=mesh_6, Length=number_slider_6, Iterations=25)  # -> Triangulation, Dual, Creases
medges_3 = MeshEdges(Mesh=triremesh_2.Triangulation)  # -> NakedEdges, InteriorEdges, NonManifoldEdges
mesh_7 = Mesh(triremesh_2.Triangulation)
unweld = UnweldMesh(Mesh=mesh_7, Angle=degrees(Slider(9, range=0..10)))
topography = AddTopographyMesh(Mesh=unweld, TrackingMode=2)

toggle_5 = GroupToggle(ToggleActive=True, ToggleVisible=False)  # disabled
# New Roof & Structure
cps_2 = ClosestPoints(Point=pt_5, Cloud=item_9, Count="8")  # -> ClosestPoint, CPIndex, Distance
crv_cp_4 = CurveClosestPoint(Point=cps_2.ClosestPoint, Curve=nurbs_4.Curve)  # -> Point, Parameter, Distance
avr_2 = Average(Input=crv_cp_4.Point)
cir_2 = Circle(Plane=avr_2, Radius=1)
alongcrv_2 = SortAlongCurve(Points=crv_cp_4.Point, Curve=cir_2)  # -> Points, Indices
vec2pt = Vector2Pt(PointA=alongcrv_2.Points, PointB=avr_2, Unitize=False)  # -> Vector, Length
shatter = Shatter(Curve=nurbs_4.Curve, Parameters=flatten(crv_cp_4.Parameter))
amp_4 = Amplitude(Vector=vec2pt.Vector, Amplitude=Slider(7, range=0..20))
move_18 = Move(Geometry=alongcrv_2.Points, Motion=amp_4)  # -> Geometry, Transform
panel_22 = Panel("""2
4""")
ln = Line(StartPoint=alongcrv_2.Points, EndPoint=move_18.Geometry)
panel_23 = Panel("""0
6""")
panel_24 = Panel("""7
15
21
5
23
31""")
end = EndPoints(Curve=ln)  # -> Start, End
entwine = Entwine(Branch00="0", Branch01=panel_22, Branch02=panel_23, Branch03="4", FlattenInputs=True)
dispdexs = DispatchIndices(List=shatter, Indices=panel_24)  # -> AtI, NotI
shift_2 = ShiftList(List=end.End, Shift=1, Wrap=True)
ln_2 = Line(StartPoint=end.End, EndPoint=shift_2)
number_slider_7 = Slider(12, range=0..100)
partition_2 = PartitionList(List=dispdexs.AtI, Size="2")
end_2 = EndPoints(Curve=partition_2)  # -> Start, End
dispdexs_2 = DispatchIndices(List=ln_2, Indices=entwine)  # -> flatten(AtI), flatten(NotI)
shift_3 = ShiftList(List=end_2.End, Shift=1, Wrap=True)
ln_3 = Line(StartPoint=end_2.Start, EndPoint=shift_3)
divide = DivideCurve(Curve=ln, Count=number_slider_7, Kinks=False)  # -> Points, Tangents, Parameters
flatten_2 = FlattenTree(Tree=ln_3, Path="{0}")
divide_2 = DivideCurve(Curve=dispdexs.NotI, Count=number_slider_7, Kinks=False)  # -> Points, Tangents, Parameters
divide_3 = DivideCurve(Curve=partition_2, Count=number_slider_7, Kinks=False)  # -> Points, Tangents, Parameters
divide_4 = DivideCurve(Curve=ln_3, Count=number_slider_7, Kinks=False)  # -> Points, Tangents, Parameters
bang_2 = ExplodeTree(Data=simplify(divide_3.Points))  # -> Branch0, Branch1, Branch2, Branch3, Branch4, Branch5
rev_2 = ReverseList(List=bang_2.Branch1)
rev_3 = ReverseList(List=bang_2.Branch3)
rev_4 = ReverseList(List=bang_2.Branch5)
ln_4 = Line(StartPoint=bang_2.Branch0, EndPoint=rev_2)
ln_5 = Line(StartPoint=bang_2.Branch2, EndPoint=rev_3)
ln_6 = Line(StartPoint=bang_2.Branch4, EndPoint=rev_4)
divide_5 = DivideCurve(Curve=[ln_4, ln_5, ln_6], Count=number_slider_7, Kinks=False)  # -> Points, Tangents, Parameters
addition = Addition(A=number_slider_7, B="1")
trim_4 = TrimTree(Tree=divide_5.Points, Depth=1)
frompoints = MeshFromPoints(Points=trim_4, UDirection=addition, VDirection=addition)
shift_4 = ShiftList(List=divide.Points, Shift=1, Wrap=False)
shift_5 = ShiftList(List=divide_4.Points, Shift=1, Wrap=False)
shift_6 = ShiftList(List=divide_5.Points, Shift=1, Wrap=True)
ln_7 = Line(StartPoint=divide.Points, EndPoint=shift_4)
ln_8 = Line(StartPoint=divide_4.Points, EndPoint=shift_5)
ln_9 = Line(StartPoint=divide_5.Points, EndPoint=shift_6)
cull_i = CullIndex(List=ln_7, Indices=-1, Wrap=True)
cull_i_2 = CullIndex(List=ln_8, Indices=-1, Wrap=True)
cull_i_3 = CullIndex(List=ln_9, Indices=-1, Wrap=True)
midpt = CurveMiddle(Curve=flatten([cull_i, cull_i_3]))
Z_16 = UnitZ(Factor=Slider(-5.67, range=-10..5))
Z_17 = UnitZ(Factor=Slider(4, range=0..10))

# ---- group: Sorting Cores List
midpt_2 = CurveMiddle(Curve=dispdexs_2.NotI)
midpt_3 = CurveMiddle(Curve=dispdexs.NotI)  # -> graft(Midpoint)
dist = Distance(PointA=midpt_3, PointB=midpt_2)
sort_3 = SortList(Keys=dist, ValuesA=dispdexs_2.NotI)  # -> Keys, ValuesA
item_17 = ListItem(List=sort_3.ValuesA, Index=0, Wrap=True)  # -> flatten(Item)

midpt_4 = CurveMiddle(Curve=dispdexs_2.AtI)
midpt_5 = CurveMiddle(Curve=flatten_2)  # -> graft(Midpoint)
dist_2 = Distance(PointA=midpt_5, PointB=midpt_4)
sort_4 = SortList(Keys=dist_2, ValuesA=dispdexs_2.AtI)  # -> Keys, ValuesA
item_18 = ListItem(List=sort_4.ValuesA, Index=0, Wrap=True)  # -> flatten(Item)

# ---- group: Anchors (Perimeter)
pt_6 = Point(flatten([divide_2.Points, divide_3.Points]))

# ----
divide_6 = DivideCurve(Curve=item_17, Count=number_slider_7, Kinks=False)  # -> Points, Tangents, Parameters
divide_7 = DivideCurve(Curve=item_18, Count=number_slider_7, Kinks=False)  # -> Points, Tangents, Parameters
ln_10 = Line(StartPoint=divide_6.Points, EndPoint=divide_2.Points)
ln_11 = Line(StartPoint=divide_4.Points, EndPoint=divide_7.Points)
divide_8 = DivideCurve(Curve=ln_10, Count=number_slider_7, Kinks=False)  # -> Points, Tangents, Parameters
divide_9 = DivideCurve(Curve=ln_11, Count=number_slider_7, Kinks=False)  # -> Points, Tangents, Parameters
trim_5 = TrimTree(Tree=divide_8.Points, Depth=1)
trim_6 = TrimTree(Tree=divide_9.Points, Depth=1)
frompoints_2 = MeshFromPoints(Points=trim_5, UDirection=addition, VDirection=addition)
frompoints_3 = MeshFromPoints(Points=trim_6, UDirection=addition, VDirection=addition)
flip = MeshFlip(Mesh=frompoints_2)
flatten_3 = FlattenTree(Tree=[flip, frompoints, frompoints_3], Path="{0}")
duppt = RemoveDuplicatePts(Points=pt_6, Tolerance=0.01)
mjoin = MeshJoin(Meshes=flatten_3)
weldvertices = MeshWeldVertices(Mesh=mjoin, Tolerance=0.01)  # -> RuntimeMessage, Mesh
medges_4 = MeshEdges(Mesh=weldvertices.Mesh)  # -> NakedEdges, InteriorEdges, NonManifoldEdges
demesh = DeconstructMesh(Mesh=weldvertices.Mesh)  # -> Vertices, Faces, Colours, Normals
cp = ClosestPoint(Point=duppt, Cloud=demesh.Vertices)  # -> ClosestPoint, CPIndex, Distance
midpt_6 = CurveMiddle(Curve=medges_4.InteriorEdges)
cp_2 = ClosestPoint(Point=midpt, Cloud=midpt_6)  # -> ClosestPoint, CPIndex, Distance
dispdexs_3 = DispatchIndices(List=medges_4.InteriorEdges, Indices=cp_2.CPIndex)  # -> AtI, NotI
line = Line(dispdexs_3.NotI)
line_2 = Line(dispdexs_3.AtI)
anchor = Anchor(Point=cp.ClosestPoint, Strength=1000000)
length_line = LengthLine(Line=dispdexs_3.AtI, Length=Slider(0, range=0..1), Strength=Slider(66, range=0..100))
length_line_2 = LengthLine(Line=dispdexs_3.NotI, Length=Slider(0, range=0..1), Strength=Slider(14, range=0..100))
show = Show(G=weldvertices.Mesh)
show_2 = Show(G=medges_4.InteriorEdges)
show_3 = Show(G=dispdexs_3.AtI)

# ---- group: Anchors (Center)
pt_7 = Point(flatten([divide_6.Points, divide_7.Points]))

# ----
duppt_2 = RemoveDuplicatePts(Points=pt_7, Tolerance=0.01)
cp_3 = ClosestPoint(Point=duppt_2, Cloud=demesh.Vertices)  # -> ClosestPoint, CPIndex, Distance
merge_4 = Merge(Data1=cp.CPIndex, Data2=cp_3.CPIndex)
cull_i_4 = CullIndex(List=demesh.Vertices, Indices=merge_4, Wrap=True)
move_19 = Move(Geometry=cp_3.ClosestPoint, Motion=Z_16)  # -> Geometry, Transform
project_9 = ProjectPoint(Point=cp_3.ClosestPoint, Direction=Vector(0, 0, -1), Geometry=srf)  # -> Point, Index
anchor_2 = Anchor(Point=cp_3.ClosestPoint, Target=project_9.Point, Strength=1000000)
load = Load(Point=cull_i_4, ForceVector=Z_17, Weighting=1)
entwine_2 = Entwine(
    Branch0X=show,
    Branch1X=show_2,
    Branch2X=show_3,
    Branch3X=length_line,
    Branch4X=length_line_2,
    Branch5X=load,
    Branch6X=anchor,
    Branch7X=anchor_2,
    FlattenInputs=False)
bouncysolver = BouncySolver(GoalObjects=entwine_2, Reset=Button(), Threshold=1e-15, Tolerance=0.0001, Damping=0.99, Iterations=10, On=Toggle(False))  # -> I, V, O

mesh_8 = Mesh(bouncysolver.O)
null_2 = NullItem(Item=mesh_8)  # -> NullFlags, InvalidFlags, Description
cull_6 = CullPattern(List=mesh_8, CullPattern=invert(null_2.NullFlags))
line_3 = Line(bouncysolver.O)
preview_9 = CustomPreview(Geometry=cull_6, Material=ColourSwatch(SwatchColor=RGB(88, 108, 135)))  # disabled
